# Grasshopper definition Mushroom Cluster for Optimize (1).gh (Grasshopper 1.0.7)
# plug-ins: Weaverbird

# ----
# Ex. Col.
# Offset Clearance
number_slider = Slider(0.2, range=0..1)

# ----
# Existing Column
crv = Curve(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)
crv_2 = Curve(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)
crv_3 = Curve(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)
crv_4 = Curve(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)
area = Area(Geometry=crv)  # -> Area, Centroid
area_2 = Area(Geometry=crv_2)  # -> Area, Centroid
area_3 = Area(Geometry=crv_3)  # -> Area, Centroid
area_4 = Area(Geometry=crv_4)  # -> Area, Centroid

# ----
# Starting
# View Location
pt = Point(Point(3, 6, 0))

pt_2 = Point(Point(9.3, 8.825, 0))

# ----
# Ex. Column
# Boudrary
swatch = ColourSwatch(SwatchColor=RGB(0, 0, 0))
ln = Line(StartPoint=area_2.Centroid, EndPoint=area_3.Centroid)
ln_2 = Line(StartPoint=area.Centroid, EndPoint=area_2.Centroid)
ln_3 = Line(StartPoint=area_3.Centroid, EndPoint=area_4.Centroid)
ln_4 = Line(StartPoint=area.Centroid, EndPoint=area_4.Centroid)
preview = CustomPreview(Geometry=[ln_2, ln, ln_3, ln_4], Material=swatch)

offset = OffsetCurve(Curve=crv, Distance=number_slider, Corners=1)
offset_2 = OffsetCurve(Curve=crv_2, Distance=number_slider, Corners=1)
offset_3 = OffsetCurve(Curve=crv_3, Distance=number_slider, Corners=1)
offset_4 = OffsetCurve(Curve=crv_4, Distance=number_slider, Corners=1)
explode = Explode(Curve=offset_3, Recursive=True)  # -> Segments, Vertices
preview_2 = CustomPreview(Geometry=[offset, offset_2, offset_3, offset_4], Material=ColourSwatch(SwatchColor=RGBA(176, 135, 135, 124)))
explode_2 = Explode(Curve=offset, Recursive=True)  # -> Segments, Vertices
explode_3 = Explode(Curve=offset_2, Recursive=True)  # -> Segments, Vertices
explode_4 = Explode(Curve=offset_4, Recursive=True)  # -> Segments, Vertices
midpt = CurveMiddle(Curve=ln_4)
midpt_2 = CurveMiddle(Curve=ln_3)
midpt_3 = CurveMiddle(Curve=ln_2)

# ----
# Closet Pt to EX Column
item = ListItem(List=explode_3.Vertices, Index=0, Wrap=True)  # -> Item, Item1, Item2, Item3
pt_3 = Point(item.Item2)

# ----
# Closet Pt to EX Column
item_2 = ListItem(List=explode_4.Vertices, Index=0, Wrap=True)  # -> Item, Item1, Item2, Item3
pt_4 = Point(item_2.Item)

# ----
# Closet Pt to EX Column
item_3 = ListItem(List=explode.Vertices, Index=0, Wrap=True)  # -> Item, Item1, Item2, Item3
pt_5 = Point(item_3.Item3)

# ----
# Closet Pt to EX Column
item_4 = ListItem(List=explode_2.Vertices, Index=0, Wrap=True)  # -> Item, Item1, Item2, Item3
ex_col_1_pt_2 = Point(item_4.Item1)

# ----
# Symetrical Axis
ln_5 = Line(StartPoint=midpt_3, EndPoint=midpt_2)

pt_6 = Point(item_4.Item2)
pt_7 = Point(item_4.Item3)
pt_8 = Point(item_4.Item)
pt_9 = Point(item_2.Item3)

# ----
# Offseted Symetrical MidPt
number_slider_2 = Slider(0.65, range=0.5..0.65)
eval = EvaluateCurve(ExEdge3=reparameterize(ln_3), Parameter=number_slider_2)  # -> OffsetedMidPt, Tangent, Angle

Z = UnitZ(Factor=1)
extr = Extrude(Base=ln_5, Direction=Z)
angl_area1_2 = Slider(10, range=-10..30)
loc_area1 = Slider(0.54, range=0.5..0.8)
loc_area2 = Slider(1.05, range=0.85..1.23)
angl_area2_3 = Slider(7, range=-15..15)
subd = SubD(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)
subd_2 = SubD([<subd referenced from the Rhino model> x5])
subdedges = SubDEdges(SubD=subd_2, NewFormatting=False)  # -> Line, Edge, Tag, Id
cluster = Cluster(
    start_view=pt,
    syme_axis=ln_5,
    loc_area1=loc_area1,
    void=Slider(0.2, range=0..1),
    minor_void=Slider(0.5, range=0..1),
    loc_area2=loc_area2,
    angl_area1_2=angl_area1_2,
    angl_area2_3=angl_area2_3,
    area1_2_connect=Slider(0.5, range=0.45..0.6),
    area2_3_connect=Slider(0.54, range=0.5..0.65),
    offset_midpt=eval.OffsetedMidPt,
    mush_3_axis_shift=Slider(-0.4, range=-0.8..0.2),
    A=pt_8,
    B=item.Item3,
    ex_col_1_pt_2=ex_col_1_pt_2,
    ex_column1=pt_8,
    view_clr=eval.OffsetedMidPt,
    ex_col_3_clr=pt_7,
    main_view=pt,
    ex_col_3_pt_4=item_2.Item3,
    P=midpt,
    ex_col_1_clr=pt_2,
    mush1_wing=Slider(0.4, range=0.3..0.6),
    main_view_2=pt)  # -> total_area, mushroom1, mushrooom2, mushroom2_1, mushroom3, mushroom3_1, mush_1_poly, mush_2_poly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
subdverts = SubDVertices(SubD=subd)  # -> Point, Id, Tag
subdedges_2 = SubDEdges(SubD=subd, NewFormatting=False)  # -> Line, Edge, Tag, Id
crv_5 = Curve([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])
crv_6 = Curve(subdedges.Line)
crv_7 = Curve(subdedges_2.Line)
wbweave = WeaverbirdsMeshFromLinesWeaveBack(Lines=crv_6, MaximumValence=4)
wbweave_2 = WeaverbirdsMeshFromLinesWeaveBack(Lines=crv_7, MaximumValence=4)
xz = XZPlane(Origin=pt)
panel = Panel(cluster.total_area)
disjoint = DisjointMesh(Mesh=wbweave_2)  # -> graft(Meshes)
demesh = DeconstructMesh(Mesh=wbweave)  # -> Vertices, Faces, Colours, Normals
crv_8 = Curve([cluster.mushroom1, cluster.mushrooom2, cluster.mushroom2_1, cluster.mushroom3, cluster.mushroom3_1])
area_5 = Area(Geometry=cluster.mushroom1)  # -> Area, Centroid
area_6 = Area(Geometry=cluster.mushrooom2)  # -> Area, Centroid
area_7 = Area(Geometry=cluster.mushroom3)  # -> Area, Centroid
mirror = Mirror(Geometry=disjoint, Plane=xz)  # -> Geometry, Transform
flatten = FlattenTree(Tree=demesh.Vertices, Path="{0}")
merge = Merge(Data1=disjoint, Data2=mirror.Geometry)

# ----
# Column 1
number_slider_3 = Slider(0.5, range=0..1)
cir = Circle(Plane=area_5.Centroid, Radius=number_slider_3)
boundary = BoundarySurfaces(Edges=cir)
# Main Symetrical
preview_3 = CustomPreview(Geometry=[boundary, cluster.mushroom1], Material=ColourSwatch(SwatchColor=RGB(178, 162, 127)))

# ----
# Column 2
number_slider_4 = Slider(0.3, range=0..1)
cir_2 = Circle(Plane=area_6.Centroid, Radius=number_slider_4)
boundary_2 = BoundarySurfaces(Edges=cir_2)
# Main Symetrical
preview_4 = CustomPreview(Geometry=[boundary_2, cluster.mushrooom2, cluster.mushroom2_1], Material=ColourSwatch(SwatchColor=RGB(122, 151, 153)))

# ----
# Column 3
number_slider_5 = Slider(0.3, range=0..1)
cir_3 = Circle(Plane=area_7.Centroid, Radius=number_slider_5)
boundary_3 = BoundarySurfaces(Edges=cir_3)
preview_5 = CustomPreview(Geometry=[boundary_3, cluster.mushroom3, cluster.mushroom3_1], Material=ColourSwatch(SwatchColor=RGB(167, 126, 168)))

explode_5 = Explode(Curve=crv_8, Recursive=True)  # -> Segments, Vertices
cullpt = CullDuplicates(Points=flatten, Tolerance=Slider(0.03, range=0..0.1), CullMode=3)  # -> Points, Indices, Valence
bang = ExplodeTree(Data=merge)  # -> _0000, _0001, _0002
cp = ClosestPoint(Point=demesh.Vertices, Cloud=cullpt.Points)  # -> ClosestPoint, CPIndex, Distance
mesh = Mesh([bang._0000, bang._0002])
conmesh = ConstructMesh(Vertices=cp.ClosestPoint, Faces=demesh.Faces)
wbcatmullclark = WeaverbirdsCatmullClarkSubdivision(MeshCurves=conmesh, Level=1, SmoothNakedEdges=1)  # disabled

# ----
# Ex. Col.
# Offset Clearance
number_slider_6 = Slider(0.2, range=0..1)

# ----
# Existing Column
crv_9 = Curve(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)
crv_10 = Curve(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)
crv_11 = Curve(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)
crv_12 = Curve(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)
area_8 = Area(Geometry=crv_9)  # -> Area, Centroid
area_9 = Area(Geometry=crv_10)  # -> Area, Centroid
area_10 = Area(Geometry=crv_11)  # -> Area, Centroid
area_11 = Area(Geometry=crv_12)  # -> Area, Centroid

# ----
# Starting
# View Location
pt_10 = Point(Point(3, 6, 0))

pt_11 = Point(Point(9.3, 8.825, 0))

# ----
# Ex. Column
# Boudrary
swatch_2 = ColourSwatch(SwatchColor=RGB(0, 0, 0))
ln_6 = Line(StartPoint=area_9.Centroid, EndPoint=area_10.Centroid)
ln_7 = Line(StartPoint=area_8.Centroid, EndPoint=area_9.Centroid)
ln_8 = Line(StartPoint=area_10.Centroid, EndPoint=area_11.Centroid)
ln_9 = Line(StartPoint=area_8.Centroid, EndPoint=area_11.Centroid)
preview_6 = CustomPreview(Geometry=[ln_7, ln_6, ln_8, ln_9], Material=swatch_2)

offset_5 = OffsetCurve(Curve=crv_9, Distance=number_slider_6, Corners=1)
offset_6 = OffsetCurve(Curve=crv_10, Distance=number_slider_6, Corners=1)
offset_7 = OffsetCurve(Curve=crv_11, Distance=number_slider_6, Corners=1)
offset_8 = OffsetCurve(Curve=crv_12, Distance=number_slider_6, Corners=1)
explode_6 = Explode(Curve=offset_7, Recursive=True)  # -> Segments, Vertices
preview_7 = CustomPreview(Geometry=[offset_5, offset_6, offset_7, offset_8], Material=ColourSwatch(SwatchColor=RGBA(176, 135, 135, 124)))
explode_7 = Explode(Curve=offset_5, Recursive=True)  # -> Segments, Vertices
explode_8 = Explode(Curve=offset_6, Recursive=True)  # -> Segments, Vertices
explode_9 = Explode(Curve=offset_8, Recursive=True)  # -> Segments, Vertices
midpt_4 = CurveMiddle(Curve=ln_9)
midpt_5 = CurveMiddle(Curve=ln_8)
midpt_6 = CurveMiddle(Curve=ln_7)

# ----
# Closet Pt to EX Column
item_5 = ListItem(List=explode_8.Vertices, Index=0, Wrap=True)  # -> Item, Item1, Item2, Item3
pt_12 = Point(item_5.Item2)

# ----
# Closet Pt to EX Column
item_6 = ListItem(List=explode_9.Vertices, Index=0, Wrap=True)  # -> Item, Item1, Item2, Item3
pt_13 = Point(item_6.Item)

# ----
# Closet Pt to EX Column
item_7 = ListItem(List=explode_6.Vertices, Index=0, Wrap=True)  # -> Item, Item1, Item2, Item3
pt_14 = Point(item_7.Item3)

# ----
# Closet Pt to EX Column
item_8 = ListItem(List=explode_7.Vertices, Index=0, Wrap=True)  # -> Item, Item1, Item2, Item3
ex_col_1_pt_2_2 = Point(item_8.Item1)

# ----
# Symetrical Axis
ln_10 = Line(StartPoint=midpt_6, EndPoint=midpt_5)

pt_15 = Point(item_8.Item2)
pt_16 = Point(item_8.Item3)
pt_17 = Point(item_8.Item)
pt_18 = Point(item_6.Item3)

# ----
# Offseted Symetrical MidPt
number_slider_7 = Slider(0.65, range=0.5..0.65)
eval_2 = EvaluateCurve(ExEdge3=reparameterize(ln_8), Parameter=number_slider_7)  # -> OffsetedMidPt, Tangent, Angle

Z_2 = UnitZ(Factor=1)
extr_2 = Extrude(Base=ln_10, Direction=Z_2)
angl_area1_2_2 = Slider(10, range=-10..30)
loc_area1_2 = Slider(0.54, range=0.5..0.8)
loc_area2_2 = Slider(1.05, range=0.85..1.23)
angl_area2_3_2 = Slider(7, range=-15..15)
ln_11 = Line(ExCol1Clr=pt_11, EndPoint=pt_10)
ln_12 = Line(ExCol3Clr=pt_16, EndPoint=pt_10)
ext = ExtendCurve(Curve=ln_12, Type=0, Start=10, End=10)
ext_2 = ExtendCurve(Curve=ln_11, Type=0, Start=10, End=10)
eval_3 = EvaluateCurve(SymetricalAxis=ln_10, LocArea1=loc_area1_2)  # -> Point, Tangent, Angle
tweencrv = TweenCurve(CurveA=ext, CurveB=ext_2, Factor=0.5, BlendType=0)
crv_cp = CurveClosestPoint(Point=midpt_4, Curve=tweencrv)  # -> Point, Parameter, Distance

# ----
# Area 3
pt_19 = Point(crv_cp.Point)
cir_4 = Circle(Plane=pt_19, Radius=0.3)

# ----
# Area 1
pt_20 = Point(eval_3.Point)
cir_5 = Circle(Plane=pt_20, Radius=0.3)

ln_13 = Line(StartPoint=eval_2.OffsetedMidPt, StartView=pt_10)
ln_14 = Line(StartPoint=pt_20, ExColumn1=pt_17)
offset_9 = OffsetCurve(Curve=ln_13, LocArea2=loc_area2_2, Corners=1)
ccx = CurveCurve(CurveA=ln_14, CurveB=offset_9)  # -> Points, ParamsA, ParamsB

# ----
# Area 2
pt_21 = Point(ccx.Points)
cir_6 = Circle(Plane=pt_21, Radius=0.3)

# ----
# Center
# Connection
ln_15 = Line(StartPoint=pt_20, EndPoint=pt_21)
ln_16 = Line(StartPoint=pt_21, EndPoint=pt_19)
ln_17 = Line(StartPoint=pt_20, EndPoint=pt_19)

hframe = HorizontalFrame(Curve=ln_16, Area23Connect=Slider(0.54, range=0.5..0.65))
hframe_2 = HorizontalFrame(Curve=ln_15, Area12Connect=Slider(0.5, range=0.45..0.6))
deplane = DeconstructPlane(Plane=hframe_2)  # -> Origin, XAxis, YAxis, ZAxis
deplane_2 = DeconstructPlane(Plane=hframe)  # -> Origin, XAxis, YAxis, ZAxis

vrot = Rotate(Vector=deplane.YAxis, Axis=deplane.ZAxis, AnglArea12=degrees(angl_area1_2_2))
vrot_2 = Rotate(Vector=deplane_2.YAxis, Axis=deplane_2.ZAxis, AnglArea23=degrees(angl_area2_3_2))
line = LineSDL(Start=deplane.Origin, Direction=vrot, Length=15)
line_2 = LineSDL(Start=deplane_2.Origin, Direction=vrot_2, Length=10)
ccx_2 = CurveCurve(CurveA=line, SymeAxis=ln_10)  # -> Pt1Syme, ParamsA, ParamsB

ln_18 = Line(StartPoint=ccx_2.Pt1Syme, EndPoint=pt_21)
Z_3 = UnitZ(Factor=1)
extr_3 = Extrude(Base=ln_18, Direction=Z_3)

ln_19 = Line(StartPoint=pt_17, EndPoint=item_5.Item3)
ln_20 = Line(StartPoint=deplane.Origin, EndPoint=ccx_2.Pt1Syme)
crv_cp_2 = CurveClosestPoint(Point=ccx_2.Pt1Syme, ExEdge1=ln_19)  # -> Point, Parameter, Distance
ln_21 = Line(StartPoint=ccx_2.Pt1Syme, EndPoint=crv_cp_2.Point)
mirror_2 = Mirror(Geometry=deplane_2.Origin, Plane=extr_3)  # -> Geometry, Transform

# ----
# Crv. Extend
panel_2 = Panel("10")

ln_22 = Line(StartPoint=mirror_2.Geometry, ExCol1Pt2=ex_col_1_pt_2_2)
eval_4 = EvaluateCurve(Curve=reparameterize(ln_21), Parameter=Slider(0.2, range=0..1))  # -> Point, Tangent, Angle
ext_3 = ExtendCurve(Curve=line_2, Type=0, Start=panel_2, End=panel_2)
ext_4 = ExtendCurve(Curve=ln_20, Type=0, Start=panel_2, End=panel_2)
ext_5 = ExtendCurve(Curve=ln_22, Type=0, Start=panel_2, End=panel_2)
ccx_3 = CurveCurve(CurveA=ext_5, CurveB=ext_3)  # -> Points, ParamsA, ParamsB

Z_4 = UnitZ(Factor=1)
extr_4 = Extrude(Area3Syme=tweencrv, Direction=Z_4)
crv_cp_3 = CurveClosestPoint(Point=ccx_3.Points, Curve=extr_4)  # -> Point, Parameter, Distance
vec2pt = Vector2Pt(PointA=ccx_3.Points, PointB=crv_cp_3.Point, Unitize=False)  # -> Vector, Length
amp = Amplitude(Vector=vec2pt.Vector, Mush3AxisShift=Slider(-0.4, range=-0.8..0.2))
move = Move(Geometry=extr_4, Motion=amp)  # -> Geometry, Transform

ccx_4 = CurveCurve(CurveA=ext_3, CurveB=ext_4)  # -> Points, ParamsA, ParamsB

ln_23 = Line(ExCol3Pt4=item_6.Item3, EndPoint=ccx_4.Points)
eval_5 = EvaluateCurve(Curve=ln_23, Mush1Wing=Slider(0.4, range=0.3..0.6))  # -> Point, Tangent, Angle

Z_5 = UnitZ(Factor=1)
ccx_5 = CurveCurve(CurveA=ext_4, CurveB=tweencrv)  # -> Points, ParamsA, ParamsB
crv_cp_4 = CurveClosestPoint(Point=eval_5.Point, ClrOffset=offset_9)  # -> Point, Parameter, Distance
extr_5 = Extrude(MainSymetricalAxis=ln_10, Direction=Z_5)
merge_2 = Merge(Data1=ccx_4.Points, Data2=eval_5.Point)
ln_24 = Line(StartPoint=deplane.Origin, EndPoint=ccx_4.Points)
eval_6 = EvaluateCurve(Curve=reparameterize(ln_24), MinorVoid=Slider(0.5, range=0..1))  # -> Point, Tangent, Angle
mirror_3 = Mirror(Geometry=merge_2, ShiftedSyme=move.Geometry)  # -> Geometry, Transform
merge_3 = Merge(Data1=deplane_2.Origin, Data2=ccx_4.Points, Data3=eval_5.Point)
offset_midpt = Point(eval_2.OffsetedMidPt)
merge_4 = Merge(Data1=deplane.Origin, Data2=ccx_4.Points, Data3=eval_5.Point, Data4=crv_cp_4.Point, Data5=offset_midpt)
merge_5 = Merge(Data1=ccx_5.Points, Data2=merge_3, Data3=mirror_3.Geometry)
merge_6 = Merge(
    Data1=eval_4.Point,
    Data2=crv_cp_2.Point,
    Data3=mirror_2.Geometry,
    Data4=ccx_3.Points,
    Data6=deplane_2.Origin,
    Data7=ex_col_1_pt_2_2,
    Data8=deplane.Origin,
    Data9=eval_6.Point)
pt_22 = Point(ccx_5.Points)
pt_23 = Point(eval_4.Point)
pt_24 = Point(deplane.Origin)
crv_cp_5 = CurveClosestPoint(Point=pt_22, Curve=reparameterize(cir_4))  # -> Point, Parameter, Distance
crv_cp_6 = CurveClosestPoint(Point=pt_23, Curve=reparameterize(cir_6))  # -> Point, Parameter, Distance
crv_cp_7 = CurveClosestPoint(Point=pt_24, Curve=reparameterize(cir_5))  # -> Point, Parameter, Distance
seam = Seam(Curve=reparameterize(cir_4), Seam=crv_cp_5.Parameter)
seam_2 = Seam(Curve=reparameterize(cir_6), Seam=crv_cp_6.Parameter)
seam_3 = Seam(Curve=reparameterize(cir_5), Seam=crv_cp_7.Parameter)
mirror_4 = Mirror(Geometry=merge_4, Plane=extr_5)  # -> Geometry, Transform

alongcrv = SortAlongCurve(Points=flatten(merge_6), Column2Cir=seam_2)  # -> Points, Indices
pline = PolyLine(Vertices=alongcrv.Points, Closed=invert(False))
fillet = FilletDistance(Curve=pline, Distance=Slider(0.3, range=0..1))
boundary_4 = BoundarySurfaces(Edges=fillet)

alongcrv_2 = SortAlongCurve(Points=flatten(merge_5), Column3Cir=seam)  # -> Points, Indices
pline_2 = PolyLine(Vertices=alongcrv_2.Points, Closed=invert(False))
fillet_2 = FilletDistance(Curve=pline_2, Distance=Slider(0.4, range=0..1))
boundary_5 = BoundarySurfaces(Edges=fillet_2)

alongcrv_3 = SortAlongCurve(Points=flatten([merge_4, mirror_4.Geometry]), Column1Cir=seam_3)  # -> Points, Indices
pline_3 = PolyLine(Vertices=alongcrv_3.Points, Closed=invert(False))
# Mushroom 1
fillet_3 = FilletDistance(Curve=pline_3, Distance=Slider(0.3, range=0..1))
boundary_6 = BoundarySurfaces(Edges=fillet_3)

number_slider_8 = Slider(0.61, range=0..1)
xz_2 = XZPlane(Origin=pt_10)
pcx = CurvePlane(Curve=boundary_6, Plane=xz_2)  # -> Points, ParamsC, ParamsP
number_slider_9 = Slider(0.44, range=0..1)
explode_10 = Explode(Curve=fillet_3, Recursive=True)  # -> Segments, Vertices
pline_4 = PolyLine(Vertices=pcx.Points, Closed=False)
addition = Addition(A=number_slider_8, B="0.3")
merge_7 = Merge(Data1=boundary_4, Data2=boundary_5)
pline_5 = PolyLine(Vertices=explode_10.Vertices, Closed=False)
points = PointList(Points=alongcrv_3.Points, Size=number_slider_9)
points_2 = PointList(Points=explode_10.Vertices, Size=number_slider_9)
neg = Negative(Value=addition)
mirror_5 = Mirror(Geometry=merge_7, Plane=extr_5)  # -> Geometry, Transform
ext_6 = ExtendCurve(Curve=pline_4, Type=0, Start=neg, End=neg)
item_9 = ListItem(List=explode_10.Vertices, Index=0, Wrap=True)  # -> Item, Item1
merge_8 = Merge(Data1=mirror_5.Geometry, Data2=boundary_6, Data3=merge_7)
eval_7 = EvaluateCurve(Curve=reparameterize(ext_6), Parameter=Slider(0, range=0..1))  # -> Point, Tangent, Angle
ln_25 = Line(StartPoint=item_9.Item, EndPoint=item_9.Item1)
area_12 = Area(Geometry=flatten(merge_8))  # -> Area, Centroid
mirror_6 = Mirror(Geometry=boundary_4, Plane=extr_5)  # -> Mushroom21, Transform
mirror_7 = Mirror(Geometry=boundary_5, Plane=extr_5)  # -> Mushroom31, Transform
mirror_8 = Mirror(Geometry=pline, Plane=extr_5)  # -> Mush21Poly, Transform
mirror_9 = Mirror(Geometry=pline_2, Plane=extr_5)  # -> Mush31Poly, Transform
cir_7 = Circle(Plane=eval_7.Point, Radius=number_slider_8)
ma = MassAddition(Input=flatten(area_12.Area))  # -> TotalArea, PartialResults
panel_3 = Panel(ma.TotalArea)
crv_13 = Curve(flatten([boundary_6, boundary_4, mirror_6.Mushroom21, boundary_5, mirror_7.Mushroom31]))
area_13 = Area(Geometry=boundary_6)  # -> Area, Centroid
area_14 = Area(Geometry=boundary_4)  # -> Area, Centroid
area_15 = Area(Geometry=boundary_5)  # -> Area, Centroid

# ==== cluster Cluster
ex_col_3_clr = ClusterInput()
main_view = ClusterInput()
ex_col_1_clr = ClusterInput()
main_view_2 = ClusterInput()
mush_3_axis_shift = ClusterInput()
ex_column1 = ClusterInput()
view_clr = ClusterInput()
offset_midpt = ClusterInput()
start_view = ClusterInput()
syme_axis = ClusterInput()
loc_area1 = ClusterInput()
loc_area2 = ClusterInput()
angl_area1_2 = ClusterInput()
angl_area2_3 = ClusterInput()
area1_2_connect = ClusterInput()
area2_3_connect = ClusterInput()
ln = Line(ExCol1Clr=ex_col_1_clr, EndPoint=main_view_2)
ln_2 = Line(ExCol3Clr=ex_col_3_clr, EndPoint=main_view)
ext = ExtendCurve(Curve=ln_2, Type=0, Start=10, End=10)
ext_2 = ExtendCurve(Curve=ln, Type=0, Start=10, End=10)
eval = EvaluateCurve(SymetricalAxis=syme_axis, LocArea1=loc_area1)  # -> Point, Tangent, Angle
tweencrv = TweenCurve(CurveA=ext, CurveB=ext_2, Factor=0.5, BlendType=0)
P = ClusterInput()
crv_cp = CurveClosestPoint(Point=P, Curve=tweencrv)  # -> Point, Parameter, Distance

# ----
# Area 3
pt = Point(crv_cp.Point)
cir = Circle(Plane=pt, Radius=0.3)

# ----
# Area 1
pt_2 = Point(eval.Point)
cir_2 = Circle(Plane=pt_2, Radius=0.3)

ln_3 = Line(StartPoint=view_clr, StartView=start_view)
ln_4 = Line(StartPoint=pt_2, ExColumn1=ex_column1)
offset = OffsetCurve(Curve=ln_3, LocArea2=loc_area2, Corners=1)
ccx = CurveCurve(CurveA=ln_4, CurveB=offset)  # -> Points, ParamsA, ParamsB

# ----
# Area 2
pt_3 = Point(ccx.Points)
cir_3 = Circle(Plane=pt_3, Radius=0.3)

# ----
# Center
# Connection
ln_5 = Line(StartPoint=pt_2, EndPoint=pt_3)
ln_6 = Line(StartPoint=pt_3, EndPoint=pt)
ln_7 = Line(StartPoint=pt_2, EndPoint=pt)

hframe = HorizontalFrame(Curve=ln_6, Area23Connect=area2_3_connect)
hframe_2 = HorizontalFrame(Curve=ln_5, Area12Connect=area1_2_connect)
deplane = DeconstructPlane(Plane=hframe_2)  # -> Origin, XAxis, YAxis, ZAxis
deplane_2 = DeconstructPlane(Plane=hframe)  # -> Origin, XAxis, YAxis, ZAxis

vrot = Rotate(Vector=deplane.YAxis, Axis=deplane.ZAxis, AnglArea12=degrees(angl_area1_2))
vrot_2 = Rotate(Vector=deplane_2.YAxis, Axis=deplane_2.ZAxis, AnglArea23=degrees(angl_area2_3))
line = LineSDL(Start=deplane.Origin, Direction=vrot, Length=15)
line_2 = LineSDL(Start=deplane_2.Origin, Direction=vrot_2, Length=10)
ccx_2 = CurveCurve(CurveA=line, SymeAxis=syme_axis)  # -> Pt1Syme, ParamsA, ParamsB
A = ClusterInput()
B = ClusterInput()

ln_8 = Line(StartPoint=ccx_2.Pt1Syme, EndPoint=pt_3)
Z = UnitZ(Factor=1)
extr = Extrude(Base=ln_8, Direction=Z)

ln_9 = Line(StartPoint=A, EndPoint=B)
ln_10 = Line(StartPoint=deplane.Origin, EndPoint=ccx_2.Pt1Syme)
void = ClusterInput()
ex_col_3_pt_4 = ClusterInput()
ex_col_1_pt_2 = ClusterInput()
crv_cp_2 = CurveClosestPoint(Point=ccx_2.Pt1Syme, ExEdge1=ln_9)  # -> Point, Parameter, Distance
ln_11 = Line(StartPoint=ccx_2.Pt1Syme, EndPoint=crv_cp_2.Point)
mush1_wing = ClusterInput()
mirror = Mirror(Geometry=deplane_2.Origin, Plane=extr)  # -> Geometry, Transform

# ----
# Crv. Extend
panel = Panel("10")

ln_12 = Line(StartPoint=mirror.Geometry, ExCol1Pt2=ex_col_1_pt_2)
eval_2 = EvaluateCurve(Curve=reparameterize(ln_11), Parameter=void)  # -> Point, Tangent, Angle
ext_3 = ExtendCurve(Curve=line_2, Type=0, Start=panel, End=panel)
ext_4 = ExtendCurve(Curve=ln_10, Type=0, Start=panel, End=panel)
ext_5 = ExtendCurve(Curve=ln_12, Type=0, Start=panel, End=panel)
minor_void = ClusterInput()
ccx_3 = CurveCurve(CurveA=ext_5, CurveB=ext_3)  # -> Points, ParamsA, ParamsB

Z_2 = UnitZ(Factor=1)
extr_2 = Extrude(Area3Syme=tweencrv, Direction=Z_2)
crv_cp_3 = CurveClosestPoint(Point=ccx_3.Points, Curve=extr_2)  # -> Point, Parameter, Distance
vec2pt = Vector2Pt(PointA=ccx_3.Points, PointB=crv_cp_3.Point, Unitize=False)  # -> Vector, Length
amp = Amplitude(Vector=vec2pt.Vector, Mush3AxisShift=mush_3_axis_shift)
move = Move(Geometry=extr_2, Motion=amp)  # -> Geometry, Transform

ccx_4 = CurveCurve(CurveA=ext_3, CurveB=ext_4)  # -> Points, ParamsA, ParamsB

ln_13 = Line(ExCol3Pt4=ex_col_3_pt_4, EndPoint=ccx_4.Points)
eval_3 = EvaluateCurve(Curve=ln_13, Mush1Wing=mush1_wing)  # -> Point, Tangent, Angle

Z_3 = UnitZ(Factor=1)
ccx_5 = CurveCurve(CurveA=ext_4, CurveB=tweencrv)  # -> Points, ParamsA, ParamsB
crv_cp_4 = CurveClosestPoint(Point=eval_3.Point, ClrOffset=offset)  # -> Point, Parameter, Distance
extr_3 = Extrude(MainSymetricalAxis=syme_axis, Direction=Z_3)
merge = Merge(Data1=ccx_4.Points, Data2=eval_3.Point)
ln_14 = Line(StartPoint=deplane.Origin, EndPoint=ccx_4.Points)
eval_4 = EvaluateCurve(Curve=reparameterize(ln_14), MinorVoid=minor_void)  # -> Point, Tangent, Angle
mirror_2 = Mirror(Geometry=merge, ShiftedSyme=move.Geometry)  # -> Geometry, Transform
merge_2 = Merge(Data1=deplane_2.Origin, Data2=ccx_4.Points, Data3=eval_3.Point)
offset_midpt_2 = Point(offset_midpt)
merge_3 = Merge(Data1=deplane.Origin, Data2=ccx_4.Points, Data3=eval_3.Point, Data4=crv_cp_4.Point, Data5=offset_midpt_2)
merge_4 = Merge(Data1=ccx_5.Points, Data2=merge_2, Data3=mirror_2.Geometry)
merge_5 = Merge(
    Data1=eval_2.Point,
    Data2=crv_cp_2.Point,
    Data3=mirror.Geometry,
    Data4=ccx_3.Points,
    Data6=deplane_2.Origin,
    Data7=ex_col_1_pt_2,
    Data8=deplane.Origin,
    Data9=eval_4.Point)
mirror_3 = Mirror(Geometry=merge_3, Plane=extr_3)  # -> Geometry, Transform

alongcrv = SortAlongCurve(Points=flatten(merge_5), Column2Cir=cir_3)  # -> Points, Indices
pline = PolyLine(Vertices=alongcrv.Points, Closed=invert(False))
fillet = FilletDistance(Curve=pline, Distance=Slider(0.3, range=0..1))
boundary = BoundarySurfaces(Edges=fillet)

points = PointList(Points=alongcrv.Points, Size=Slider(1, range=0..10))

alongcrv_2 = SortAlongCurve(Points=flatten(merge_4), Column3Cir=cir)  # -> Points, Indices
pline_2 = PolyLine(Vertices=alongcrv_2.Points, Closed=invert(False))
fillet_2 = FilletDistance(Curve=pline_2, Distance=Slider(0.4, range=0..1))
boundary_2 = BoundarySurfaces(Edges=fillet_2)

alongcrv_3 = SortAlongCurve(Points=flatten(merge_5), Column2Cir=cir_3)  # -> Points, Indices; disabled
number_slider = Slider(0, range=0..1)  # disabled
pline_3 = PolyLine(Vertices=alongcrv_3.Points, Closed=invert(False))  # disabled
fillet_3 = FilletDistance(Curve=pline_3, Distance=number_slider)  # disabled
boundary_3 = BoundarySurfaces(Edges=fillet_3)  # disabled

alongcrv_4 = SortAlongCurve(Points=flatten(merge_4), Column3Cir=cir)  # -> Points, Indices; disabled
number_slider_2 = Slider(0, range=0..1)  # disabled
pline_4 = PolyLine(Vertices=alongcrv_4.Points, Closed=invert(False))  # disabled
fillet_4 = FilletDistance(Curve=pline_4, Distance=number_slider_2)  # disabled
boundary_4 = BoundarySurfaces(Edges=fillet_4)  # disabled

alongcrv_5 = SortAlongCurve(Points=flatten([merge_3, mirror_3.Geometry]), Column1Cir=cir_2)  # -> Points, Indices
pline_5 = PolyLine(Vertices=alongcrv_5.Points, Closed=invert(False))
# Mushroom 1
fillet_5 = FilletDistance(Curve=pline_5, Distance=Slider(0.3, range=0..1))
boundary_5 = BoundarySurfaces(Edges=fillet_5)

alongcrv_6 = SortAlongCurve(Points=flatten([merge_3, mirror_3.Geometry]), Column1Cir=cir_2)  # -> Points, Indices; disabled
number_slider_3 = Slider(0, range=0..1)  # disabled
pline_6 = PolyLine(Vertices=alongcrv_6.Points, Closed=invert(False))  # disabled
# Mushroom 1
fillet_6 = FilletDistance(Curve=pline_6, Distance=number_slider_3)  # disabled
boundary_6 = BoundarySurfaces(Edges=fillet_6)  # disabled

merge_6 = Merge(Data1=boundary, Data2=boundary_2)
crv = Curve(boundary_6)  # disabled
crv_2 = Curve(boundary_3)  # disabled
crv_3 = Curve(boundary_4)  # disabled
area = Area(Geometry=boundary_5)  # -> Area, Centroid
explode = Explode(Curve=crv, Recursive=True)  # -> Segments, Vertices; disabled
explode_2 = Explode(Curve=crv_2, Recursive=True)  # -> Segments, Vertices; disabled
explode_3 = Explode(Curve=crv_3, Recursive=True)  # -> Segments, Vertices; disabled
mirror_4 = Mirror(Geometry=merge_6, Plane=extr_3)  # -> Geometry, Transform
merge_7 = Merge(Data1=mirror_4.Geometry, Data2=boundary_5, Data3=merge_6)
area_2 = Area(Geometry=flatten(merge_7))  # -> Area, Centroid
mirror_5 = Mirror(Geometry=boundary, Plane=extr_3)  # -> Mushroom21, Transform
mirror_6 = Mirror(Geometry=boundary_2, Plane=extr_3)  # -> Mushroom31, Transform
mirror_7 = Mirror(Geometry=pline, Plane=extr_3)  # -> Mush21Poly, Transform
mirror_8 = Mirror(Geometry=pline_2, Plane=extr_3)  # -> Mush31Poly, Transform
ma = MassAddition(Input=flatten(area_2.Area))  # -> TotalArea, PartialResults
panel_2 = Panel(ma.TotalArea)
total_area = ClusterOutput(ma.TotalArea)
mushroom1 = ClusterOutput(boundary_5)
mushrooom2 = ClusterOutput(boundary)
mushroom2_1 = ClusterOutput(mirror_5.Mushroom21)
mushroom3 = ClusterOutput(boundary_2)
mushroom3_1 = ClusterOutput(mirror_6.Mushroom31)
mush_1_poly = ClusterOutput(pline_5)
mush_2_poly = ClusterOutput(pline)
mush_2_1_poly = ClusterOutput(mirror_7.Mush21Poly)
mush_3_poly = ClusterOutput(pline_2)
mush_3_1_poly = ClusterOutput(mirror_8.Mush31Poly)
