# Grasshopper definition first.ghx (Grasshopper 1.0.7)
# plug-ins: treesloth01, Axolotl Info

number_slider = Slider(5, range=0..10)
sqgrid = Square(Plane=PlaneXY(0, 0, 0), Size=Slider(60, range=0..100), ExtentX=number_slider, ExtentY=number_slider)  # -> Cells, Points
area = Area(Geometry=sqgrid.Cells)  # -> Area, flatten(Centroid)
dom = ConstructDomain(DomainStart=0, DomainEnd=Slider(60, range=0..100))
lng = ListLength(List=area.Centroid)
random = Random(Range=dom, Number=lng, Seed=2)
number_slider_2 = Slider(50, range=0..100)
Z = UnitZ(Factor=random)
move = Move(Geometry=area.Centroid, Motion=Z)  # -> Geometry, Transform
number_slider_3 = Slider(200, range=0..1000)
pt = ConstructPoint(XCoordinate=number_slider_2, YCoordinate=number_slider_2, ZCoordinate=0)
srfgrid = SurfaceFromPoints(Points=move.Geometry, UCount=number_slider, Interpolate=Toggle(True))
planesrf = PlaneSurface(Plane=pt, XSize=number_slider_3, YSize=number_slider_3)
wires = BrepWireframe(Brep=srfgrid, Density=-1)
pop2d = Populate2D(Region=planesrf, Count=Slider(20, range=0..100), Seed=1)
Z_2 = UnitZ(Factor=1)
join = JoinCurves(Curves=wires, Preserve=False)
project = ProjectPoint(Point=pop2d, Direction=Z_2, Geometry=srfgrid)  # -> Point, Index
divide = DivideCurve(Curve=join, Count=Slider(15, range=0..100), Kinks=False)  # -> Points, Tangents, Parameters
merge = Merge(Data1=divide.Points, Data2=project.Point)  # -> flatten(Result)
del = DelaunayMesh(Points=merge, Plane=PlaneXY(0, 0, 0))
con = DelaunayEdges(Points=merge, Plane=PlaneXY(0, 0, 0))  # -> Connectivity, Edges

yz = YZPlane(Origin=Point(0, 0, 0))
pt_2 = ConstructPoint(XCoordinate=Slider(10, range=0..10), YCoordinate=0, ZCoordinate=0)
cir = Circle(Plane=yz, Radius=1)
yz_2 = YZPlane(Origin=pt_2)
sph = Sphere(Base=pt_2, Radius=Slider(2, range=0..10))
sph_2 = Sphere(Base=PlaneXY(0, 0, 0), Radius=Slider(3, range=0..10))
yz_3 = YZPlane(Origin=Point(0, 0, 0))
boundary = BoundarySurfaces(Edges=cir)
X = UnitX(Factor=Slider(10, range=0..10))
X_2 = UnitX(Factor=Slider(2, range=0..10))
sec = BrepPlane(Brep=sph, Plane=yz_2)  # -> Curves, Points
sec_2 = BrepPlane(Brep=sph_2, Plane=yz_3)  # -> Curves, Points
extr = Extrude(Base=boundary, Direction=X_2)
loft = Loft(
    Curves=[sec.Curves, sec_2.Curves],
    Options={Adjust=False, Closed=False, LoftEnds=0, LoftSimp=0, LoftType=0, Rebuild=10, Refit=0.01})
move_2 = Move(Geometry=extr, Motion=X)  # -> Geometry, Transform
cap = CapHoles(Brep=loft)
sunion = SolidUnion(Breps=flatten([cap, sph, sph_2]))

curvepoint = PointOnCurve(con.Edges, parameter=0.5)
lng_2 = ListLength(List=curvepoint)
series = Series(Start=0, Step=1, Count=lng_2)
int = Integer(series)
tag = TextTag3D(Location=curvepoint, Text=int, Size=Slider(4, range=0..10), Justification=7)

pt_3 = ConstructPoint(XCoordinate=0, YCoordinate=0, ZCoordinate=0)
xy = XYPlane(Origin=Point(0, 0, 0))
sdiff = SolidDifference(BrepsA=sunion, BrepsB=move_2.Geometry)
end = EndPoints(Curve=con.Edges)  # -> Start, End
pl_3pt = Plane3Pt(PointA=end.Start, PointB=end.End, PointC=pt_3)  # -> simplify(graft(Plane))
pl_3pt_2 = Plane3Pt(PointA=end.End, PointB=end.Start, PointC=pt_3)  # -> simplify(graft(Plane))
orient = Orient(Geometry=sdiff, Source=xy, Target=pl_3pt)  # -> Geometry, Transform
orient_2 = Orient(Geometry=sdiff, Source=xy, Target=pl_3pt_2)  # -> Geometry, Transform

neg = Negative(Value=Slider(10, range=0..10))
ext = ExtendCurve(Curve=con.Edges, Type=0, Start=neg, End=neg)
pipe = Pipe(Curve=ext, Radius=1, Caps=0)
brep = Brep(flatten([orient.Geometry, orient_2.Geometry]))
cap_2 = CapHoles(Brep=pipe)
graft = GraftTree(Tree=brep, IncludeEmptyLists=True, IncludeNullItems=True)
preview = CustomPreview(Geometry=cap_2, Shader=ColourSwatch(SwatchColor=RGB(255, 255, 255)))
number_slider_4 = Slider(1, range=0..1)
brepinc = PointInBrep(Brep=graft, Point=merge, Strict=False)
nullrep = ReplaceNulls(Items=brepinc, Replacements=Toggle(False))  # -> Items, Count
python = GhPythonScript(x=nullrep.Items)  # -> a; inputs x: tree
# ---------- python: Python ----------
a = []
for b in x.Branches:
    for id, bool in enumerate(b):
        if bool == True:
            a.append(id)
            print(id)
# ---------- end python ----------
number_slider_5 = Slider(60, range=0..100)
clone = CloneStructure(List=brep, Structure=python)
cluster = BranchLook(data=clone, i=Slider(0, range=0..1))
area_2 = Area(Geometry=cluster)  # -> Area, Centroid
distance_wrapper = DistanceWrapper(Geometry=cluster)
python_2 = GhPythonScript(x=cluster)  # -> out, a; inputs x: list of Brep; disabled
# ---------- python_2: Python ----------
import Rhino.Geometry as rg


a = rg.Brep.CreateBooleanUnion(x, 0.01)
# ---------- end python_2 ----------
avr = Average(Input=area_2.Centroid)
boolean_union = BooleanUnion(DistanceObjectS=distance_wrapper)
bbox = BoundingBox(Content=cluster, Plane=PlaneXY(0, 0, 0), UnionBox=True)  # -> Box, Box_2
sunion_2 = SolidUnion(Breps=clone)  # disabled
isosurface_distancefunction = IsosurfaceDistancefunction(
    BoundingBox=bbox.Box,
    NumberX=number_slider_5,
    NumberY=number_slider_5,
    NumberZ=number_slider_5,
    Isovalue=0,
    Capped=False,
    DistanceObject=boolean_union,
    Refine=True)
panel = Panel(isosurface_distancefunction)

# ==== cluster BranchLook: To see the condition of branch data.
data = ClusterInput()
data_2 = Data(data)
tstat = TreeStatistics(Tree=data_2)  # -> Paths, Length, Count
i = ClusterInput()
item = ListItem(List=tstat.Paths, Index=i, Wrap=True)
branch = TreeBranch(Tree=data_2, Path=item, MaintainPaths=True)
B = ClusterOutput(branch)
